# Grasshopper definition speckle_WS_001.gh (Grasshopper 1.0.7)
# plug-ins: Speckle 2

number_slider = Slider(170, range=0..1000)
yz_plane = YZPlane(Origin=Point(0, 0, 0))
xz_plane = XZPlane(Origin=Point(0, 0, 0))
cone = Cone(Base=[yz_plane, xz_plane], Radius=number_slider, Length=number_slider)  # -> Cone, Tip
panel = Panel("https://speckle.xyz/streams/12d57a96c6")
send = Send(
    Stream=panel,
    Data=cone.Cone,
    AutoSend=False,
    BaseId="e7f7c810aefa2155652c7ba18cb6aa2f",
    CurrentComponentState="up_to_date",
    KitName="Objects",
    OutputWrappers="https://speckle.xyz\t12d57a96c6\t434dcf213e",
    UseDefaultCache=True,
    selectedKitName="Objects")
receive = Receive(
    Stream=panel,
    AutoReceive=False,
    CurrentComponentState="expired",
    ExpandOutput=True,
    LastInfoMessage="Michael Wickerson @ 2023-04-15T15:38:17.185Z: Pushed 6 elements from Grasshopper. (id:434dcf213e)",
    ReceiveOnOpen=False,
    ReceivedCommitId="434dcf213e",
    StreamWrapper="https://speckle.xyz/streams/12d57a96c6",
    selectedKitName="Objects")  # -> Info, Data
panel_2 = Panel(receive.Data)
panel_3 = Panel(send)
panel_4 = Panel(receive.Info)
