# Grasshopper definition speckle_WS_001b.gh (Grasshopper 1.0.7)
# plug-ins: Speckle 2

receive = Receive(
    Stream="https://speckle.xyz/streams/12d57a96c6",
    AutoReceive=False,
    CurrentComponentState="up_to_date",
    ExpandOutput=True,
    LastInfoMessage="Michael Wickerson @ 2023-04-15T15:38:17.185Z: Pushed 6 elements from Grasshopper. (id:434dcf213e)",
    ReceiveOnOpen=False,
    ReceivedCommitId="434dcf213e",
    StreamWrapper="https://speckle.xyz/streams/12d57a96c6",
    selectedKitName="Objects")  # -> Info, Data
panel = Panel(receive.Data)
panel_2 = Panel(receive.Info)
geometry = Geometry(receive.Data)
